# Grasshopper definition outlet_placer.gh (Grasshopper 1.0.7)

path = FilePath("C:\Users\sounok.sarkar\Desktop\outlets\json\studio_info.json")
path_2 = FilePath("C:\Users\sounok.sarkar\Desktop\outlets\json\floor_info.json")
json = PythonScript(FilePath=path, FilePath2=path_2)  # -> out, kitchens, doors, rooms, windows, a, walls, puck, outlets
# ---------- json: Python ----------
import json
import Rhino.Geometry as rh
import ghpythonlib as gh

if FilePath:
    
    # JSON file to read
    file = open(FilePath)
    
    # Load the data
    data = json.load(file)

if FilePath2:
    
    # JSON file to read
    file2 = open(FilePath2)
    
    # Load the data
    data2 = json.load(file2)

def GetPucks(data, boundary):
    pucklines = []
    pucks = data['pucks']
    dist = []
    for puck in pucks:
        #print(puck)
        pts = []
        for p in puck:
            pt = rh.Point3d(p[0], p[1], 0)
            #print(rh.Curve.Contains(boundary, pt, rh.Plane.WorldXY, 0.01))
            if str(rh.Curve.Contains(boundary, pt, rh.Plane.WorldXY, 0.01)) == 'Inside':
                pass
            else:
                pts.append(pt)
        for i in range(len(pts)-1):
            d = rh.Point3d.DistanceTo(pts[i], pts[i+1])
            dist.append(d)
        
        curve = rh.PolylineCurve(pts)
        if curve.IsClosed:
            pucklines.append(rh.PolylineCurve(pts))
        else:
            pass
    print(len(pucklines))
    return pucklines, max(dist)

class BuiObj(object):
    def __init__(self, data, string):
        self.data = data
        self.string = string
    def GetPoints(self):
        newLst = []
        for d in self.data[self.string]:
            lst = []
            for k in d:
                lst.append(rh.Point3d(k[0], k[1], k[2]))
            newLst.append(lst)
        return newLst
    def GetLine(self):
        Allpts = self.GetPoints()
        curves = []
        for pts in Allpts:
            if (pts[0].X == pts[-1].X) and (pts[0].Y == pts[-1].Y):
                pass
            else:
                pts.append(pts[0])
        for pts in Allpts:
            curves.append(rh.PolylineCurve(pts))
        return curves
    def GetDim(self, code, pts):
        dist = []
        for i in range(len(pts)-1):
            dist.append(rh.Point3d.DistanceTo(pts[i], pts[i+1]))
        if code == 'W':
            return (min(dist))
        else:
            return (max(dist))
    def AxialScale(self):
        Allpts = self.GetPoints()
        curves = []
        for pts in Allpts:
            pts.append(pts[0])
            minDist = self.GetDim('W', pts)
            new = []
            for i in range(len(pts)-1):
                dist = rh.Point3d.DistanceTo(pts[i], pts[i+1])
                if round(minDist, 3) == round(dist, 3):
                    mid = rh.Point3d((pts[i].X + pts[i+1].X)/2, (pts[i].Y + pts[i+1].Y)/2, 0)
                    vec1 = rh.Vector3d(pts[i+1].X-mid.X, pts[i+1].Y-mid.Y, 0)
                    n2 = rh.Point3d(pts[i+1].X + vec1.X, pts[i+1].Y + vec1.Y, 0)
                    n1 = rh.Point3d(pts[i].X - vec1.X, pts[i].Y - vec1.Y, 0)
                    #lst.append(rh.Point3d(pts[i].X + mid.X, pts[i].Y + mid.Y, 0))
                    #lst.append(rh.Point3d(pts[i+1].X + mid.X, pts[i+1].Y + mid.Y, 0))
                    new.append(n1)
                    new.append(n2)
                else:
                    pass
            new.append(new[0])
            curves.append(rh.PolylineCurve(new))
        return curves

def ReverseDirection(walls):
    reversed = []
    for w in walls:
        newpts = []
        para = rh.Curve.DivideByCount(w, 100, True)
        for p in para:
            pt = rh.Curve.PointAt(w, p)
            newpts.append(pt)
        newpts.reverse()
        reversed.append(rh.PolylineCurve(newpts))
    return reversed

def GetWalls(room, door, kitchen):
    params = []
    walls = []
    lengths = []
    pts = door.GetPoints()
    kitpts = kitchen.GetPoints()[0]
    for p in pts:
        lengths.append(round(door.GetDim('L', p), 3))
    lengths.append(round(kitchen.GetDim('L', kitpts), 3))
    scaleDoors = door.AxialScale()
    scaleDoors.append(kitchen.AxialScale()[0])
    for door in scaleDoors:
        events = rh.Intersect.Intersection.CurveCurve(door, room, 0.0000000001, 0.0)
        for event in events:
            #print(event.ParameterB)
            params.append(event.ParameterB)
    params.sort()
    print(params)
    #curves = rh.Curve.Split(room, params)
    curves = []
    params.append(params[0])
    params = params[1:]
    print(params) 
    i = 0
    while i < len(params):
        curves.append(rh.Curve.Trim(room, params[i], params[i+1])) 
        i += 2
    for c in curves:
        print(c.GetLength())
        if (c.GetLength() < 24):
            pass
        else:
            walls.append(c)
    return walls[1:] 

def CreateOutlet(pts, width, height):
    rects = []
    for p in pts:
        w = rh.Interval(-width/2, width/2)
        h = rh.Interval(-height/2, height/2)
        rect = rh.Rectangle3d(rh.Plane(p, rh.Vector3d(0, 0, 1)), w, h)
        rects.append(rect.ToPolyline()) 
    return rects

def WinCheck(window, wall):
    params = []
    win = window.AxialScale()[0]
    events = rh.Intersect.Intersection.CurveCurve(win, wall, 0.001, 0.0)
    for event in events:
        #print(event.ParameterB)
        params.append(event.ParameterB)
        #curves = rh.Curve.Split(wall, params)
    return params

def PlaceOutlet(data, wall, window):
    ptsA = []
    ptsB = []
    win = window.AxialScale()[0]
    for w in wall:
        #if wall length is less than 12 ft, only one outlet is necessary, which can be placed centrally or near enough
        if w.GetLength() <= 144:
            para = rh.Curve.DivideByLength(w, w.GetLength()/2.2, False)
            pt = rh.Curve.PointAt(w, para[0])
            ptsA.append(pt)
        else:
            #taking into account the tolerance of the pucks and adusting for outlets outside window
            maxD = (GetPucks(data, room_offset)[1])
            para = list(rh.Curve.DivideByLength(w, (72-2*maxD), False))[::2]
            params = []
            inter = WinCheck(window, w)
            for p in para:
                if ((p >= inter[0]) and (p <= inter[1])):
                    params.append(inter[0] - 8/w.GetLength())
                    params.append(inter[0] + 450/w.GetLength())
                else:
                    params.append(p)
            for p in params:
                ptsB.append(rh.Curve.PointAt(w, p))
    return ptsA + ptsB 

"""
def SolveInterference(outlets, pucks, wall):
    rects = []
    for o in outlets:
        pts = []
        check = []
        for p in pucks: 
            if rh.Curve.PlanarCurveCollision(o.ToPolylineCurve(), p, rh.Plane.WorldXY, 0.0001): 
                check.append(1)
                inter = rh.Intersect.Intersection.CurveCurve(o.ToPolylineCurve(), p, 0.0001, 0.0)
                for i in inter:
                    pts.append(i.PointA)
                rect = rh.Rectangle3d(rh.Plane.WorldXY, pts[0], pts[1])
                direction = rh.Curve.TangentAt(wall, rh.Curve.ClosestPoint(wall, o.CenterPoint(), 0.01)[1]) 
                for i in range(0, 4):
                    #print(rh.Curve.Contains(p, rect.Corner(i)))
                    if str(rh.Curve.Contains(p, rect.Corner(i))) == 'Inside':
                        dir1 = rh.Vector3d(rect.Corner(i)- pts[0])
                        dir2 = rh.Vector3d(rect.Corner(i)- pts[1])
                        #print(direction.IsParallelTo(dir1, 0.01))
                        oc = o.ToPolylineCurve()
                        if direction.IsParallelTo(dir1, 0.01) == (1 or -1):
                            oc.Transform(rh.Transform.Translation(dir1))
                            #print(o)
                        else:
                            oc.Transform(rh.Transform.Translation(-dir2))
                        moved = oc
                        rects.append(moved.ToPolyline()) 
                    else:
                        pass
            else:
                check.append(0)

        if 1 in check:
            pass
        else:
            rects.append(o)

    return rects

"""
def SolveInterference(outlets, puck, wall):
    cloud = rh.PointCloud(gh.components.Area(puck)[1])
    rects = []
    for o in outlets:
        pts = []
        index = int(rh.PointCloud.ClosestPoint(cloud, gh.components.Area(o)[1])) 
        if rh.Curve.PlanarCurveCollision(o.ToPolylineCurve(), puck[index], rh.Plane.WorldXY, 0.0001): 
                inter = rh.Intersect.Intersection.CurveCurve(o.ToPolylineCurve(), puck[index], 0.0001, 0.0)
                for i in inter:
                    pts.append(i.PointA)
                rect = rh.Rectangle3d(rh.Plane.WorldXY, pts[0], pts[1])
                direction = rh.Curve.TangentAt(wall, rh.Curve.ClosestPoint(wall, o.CenterPoint(), 0.01)[1]) 
                for i in range(0, 4):
                    #print(rh.Curve.Contains(p, rect.Corner(i)))
                    if str(rh.Curve.Contains(puck[index], rect.Corner(i))) == 'Inside':
                        dir1 = rh.Vector3d(rect.Corner(i)- pts[0])
                        dir2 = rh.Vector3d(rect.Corner(i)- pts[1])
                        #print(direction.IsParallelTo(dir1, 0.01))
                        oc = o.ToPolylineCurve()
                        if direction.IsParallelTo(dir1, 0.01) == (1 or -1):
                            oc.Transform(rh.Transform.Translation(dir1))
                            #print(o)
                        else:
                            oc.Transform(rh.Transform.Translation(-dir2))
                        moved = oc
                        rects.append(moved.ToPolyline()) 
                    else:
                        pass
        else:
            rects.append(o.ToPolylineCurve())
    
    return rects

def place_outlets(outlet_geom):
    outlets = []
    for o in outlet_geom:
        outlets.append(o.CenterPoint())
    return outlets

kitchen = BuiObj(data, "kitchens")
window = BuiObj(data, 'windows')
room = BuiObj(data, 'generic_rooms')
door = BuiObj(data, 'doors')

room_offset = rh.Curve.Offset(room.GetLine()[0], rh.Plane.WorldXY, -6, 0.01, rh.CurveOffsetCornerStyle.Sharp)[0]
puck = GetPucks(data2, room_offset)[0]
kitchens = kitchen.GetLine()
walls = GetWalls(room.GetLine()[0], door, kitchen)
print(len(puck))
placeOutlets = PlaceOutlet(data2, walls, window)
outlets = CreateOutlet(placeOutlets, 4, 4)

final_geom = SolveInterference(outlets, puck, room.GetLine()[0])

#placeOutlets = place_outlets(final_geom)
"""
with open('outlets.json', 'w') as json_out:
    json.dump(placeOutlets, json_out)
"""
a = final_geom
# ---------- end json ----------
len = Length(Curve=json.walls)
crv = Curve(json.a)
crv_2 = Curve(json.outlets)
crv_3 = Curve(json.walls)
area = Area(Geometry=crv)  # -> Area, Centroid
crv_4 = Curve(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)
crv_5 = Curve(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)
panel = Panel(area.Centroid)
python = GhPythonScript(x=crv_4, y=crv_5)  # -> out, a
# ---------- python: Python ----------
__author__ = "sounok.sarkar"
__version__ = "2020.08.17"

import rhinoscriptsyntax as rs
import Rhino.Geometry as rh
import time
import ghpythonlib as gh

inter = rh.Intersect.Intersection.CurveCurve(x,y, 0.0001, 0.0)
pts = []
for i in inter:
    pts.append(i.PointA)
zone = rh.Rectangle3d(rh.Plane.WorldXY, pts[0], pts[1])

direction = rh.Curve.TangentAt(x, 55)
dir1 = rh.Vector3d(zone.Corner(1)- zone.Corner(0))
dir2 = rh.Vector3d(zone.Corner(2)- zone.Corner(1))

if direction.IsParallelTo(dir1, 0.01) == (1 or -1):
    val = dir1
else:
    val = dir2

if val == 1:
    y.Transform(rh.Transform.Translation(dir1))
    moved = y
else:
    y.Transform(rh.Transform.Translation(rh.Vector3d(dir1.X*-1, dir1.Y*-1, dir1.Z*-1)))
    moved = y
 
a = moved
# ---------- end python ----------
geo = Geometry(python.a)
